# Grasshopper definition BodegaHexagonalVivo.gh (Grasshopper 1.0.7)

# ---- group: Definir grilla
# 1 grilla hexagonal
# 2 definir una curva
# 3 calcular las distancias desde los centros de las celdas a la curva
# 4 definir el umbral de cercanía
# 5 dadas las distancias y el umbral, filtrar las celdas en 2 grupos
# 6 a un grupo lo dejamos sólido
# 7 al otro grupo lo ahuecamos
yz_plane = YZPlane(Origin=Point(0, 0, 0))
hexagonal = Hexagonal(Plane=yz_plane, Size=Slider(12, range=1..20), ExtentX=Slider(14, range=1..20), ExtentY=Slider(6, range=1..20))  # -> Cells, Points

# ----
umbral_de_cercanía_de_la_curva_al_centro = Slider(19, range=0..50)  # "Umbral de cercanía de la curva al centro de cada celda"

curve = Curve(<curve referenced from the Rhino model>)
pull_point = PullPoint(Point=hexagonal.Points, Geometry=curve, ClosestOnly=True)  # -> ClosestPoint, Distance

# ---- group: Remover celdas que están más lejos que el umbral definido
smaller_than = SmallerThan(FirstNumber=pull_point.Distance, SecondNumber=umbral_de_cercanía_de_la_curva_al_centro)  # -> SmallerThan, OrEqualTo
cull_pattern = CullPattern(List=hexagonal.Cells, CullPattern=smaller_than.SmallerThan)  # -> flatten(List)

# ---- group: Definir patrón aleatorio
semilla = Slider(3, range=0..10)
construct_domain = ConstructDomain(DomainStart=0, DomainEnd=1)
list_length = ListLength(List=cull_pattern)
random = Random(Range=construct_domain, Number=list_length, Seed=semilla, Integers=True)

# ----
dividir_celdas_por_el_patrón_aleatorio = Dispatch(List=cull_pattern, DispatchPattern=random)  # -> ListA, ListB

# ---- group: Definir largo aleatorio
mínimo = Slider(10, range=0..10)
máximo = Slider(30, range=0..100)
construct_domain_2 = ConstructDomain(DomainStart=mínimo, DomainEnd=máximo)
list_length_2 = ListLength(List=dividir_celdas_por_el_patrón_aleatorio.ListA)
random_2 = Random(Range=construct_domain_2, Number=list_length_2, Seed=2)

mínimo_2 = Slider(30, range=0..100)
máximo_2 = Slider(90, range=0..100)
list_length_3 = ListLength(List=dividir_celdas_por_el_patrón_aleatorio.ListB)
construct_domain_3 = ConstructDomain(DomainStart=mínimo_2, DomainEnd=máximo_2)
random_3 = Random(Range=construct_domain_3, Number=list_length_3, Seed=2)

# ---- group: Escalamos las celdas para hacer un hueco
area = Area(Geometry=dividir_celdas_por_el_patrón_aleatorio.ListB)  # -> Area, Centroid
scale = Scale(Geometry=dividir_celdas_por_el_patrón_aleatorio.ListB, Center=area.Centroid, Factor=Slider(0.9, range=0..1))  # -> Geometry, Transform

# ---- group: Extruimos hacia adelante el valor aleatorio
unit_x = UnitX(Factor=random_2)
extrude = Extrude(Base=dividir_celdas_por_el_patrón_aleatorio.ListA, Direction=unit_x)

unit_x_2 = UnitX(Factor=random_3)
extrude_2 = Extrude(Base=dividir_celdas_por_el_patrón_aleatorio.ListB, Direction=unit_x_2)

# ----
extrude_3 = Extrude(Base=scale.Geometry, Direction=unit_x_2)
cap_holes = CapHoles(Brep=extrude)
cap_holes_2 = CapHoles(Brep=extrude_2)
cap_holes_3 = CapHoles(Brep=extrude_3)
solid_difference = SolidDifference(BrepsA=cap_holes_2, BrepsB=cap_holes_3)
