# Grasshopper definition Ejercicio Piel paramétrica.gh (Grasshopper 1.0.7)
# plug-ins: LunchBox

# ---- group: prisma inicial
number_slider = Slider(11, range=1..20)
number_slider_2 = Slider(50, range=1..50)
rectangle = Rectangle(Plane=PlaneXY(0, 0, 0), XSize=number_slider, YSize=number_slider, Radius=0)  # -> Rectangle, Length
unit_z = UnitZ(Factor=number_slider_2)
extrude = Extrude(Base=rectangle.Rectangle, Direction=unit_z)

# ----
panel = Panel(extrude)
deconstruct_brep = DeconstructBrep(Brep=extrude)  # -> Faces, Edges, Vertices

# ---- group: patron sobre sup
diamond_panels = DiamondPanels(Surface=deconstruct_brep.Faces, UDivisions=Slider(8, range=1..20), VDivisions=Slider(6, range=1..20))  # -> DiamondPanels, TriPanels

# ---- group: escalar patron
area = Area(Geometry=diamond_panels.DiamondPanels)  # -> Area, Centroid
scale = Scale(Geometry=diamond_panels.DiamondPanels, Center=area.Centroid, Factor=Slider(0.8, range=0.1..2))  # -> Geometry, Transform

# ----
surface_split = SurfaceSplit(Surface=deconstruct_brep.Faces, Curves=scale.Geometry)

# ---- group: seleccionar los rombos
area_2 = Area(Geometry=surface_split)  # -> Area, Centroid
average = Average(Input=area_2.Area)
larger_than = LargerThan(FirstNumber=area_2.Area, SecondNumber=average)  # -> LargerThan, OrEqualTo

# ---- group: eje de torsion
division = Division(A=number_slider, B=Slider(2, range=0..10))
construct_point = ConstructPoint(XCoordinate=division, YCoordinate=division, ZCoordinate=0)
construct_point_2 = ConstructPoint(XCoordinate=division, YCoordinate=division, ZCoordinate=number_slider_2)
line = Line(StartPoint=construct_point, EndPoint=construct_point_2)

# ----
number_slider_3 = Slider(3, range=1..5)
cull_pattern = CullPattern(List=surface_split, CullPattern=larger_than.LargerThan)
box_rectangle = BoxRectangle(Rectangle=rectangle.Rectangle, Height=number_slider_2)
twist = Twist(Geometry=cull_pattern, Axis=line, Angle=number_slider_3, Infinite=False, Rigid=False)
area_3 = Area(Geometry=rectangle.Rectangle)  # -> Area, Centroid
twist_2 = Twist(Geometry=box_rectangle, Axis=line, Angle=number_slider_3, Infinite=False, Rigid=False)
number_slider_4 = Slider(0.9, range=0..1)
scale_nu = ScaleNU(Geometry=twist_2, Plane=area_3.Centroid, ScaleX=number_slider_4, ScaleY=number_slider_4, ScaleZ=1)  # -> Geometry, Transform
